# Grasshopper definition mediapipe_to_Point_Bone_Demo.gh (Grasshopper 1.0.7)
# plug-ins: gHowl

construct_domain = ConstructDomain(DomainStart=1, DomainEnd=99)
udp_receiver = UDPReceiver(Address="127.0.0.1", Port="12345", Pattern="999")  # -> Info, Data
panel = Panel(udp_receiver.Info)
sub_list = SubList(List=udp_receiver.Data, Domain=construct_domain, Wrap=True)  # -> List, Index
panel_2 = Panel(udp_receiver.Data)
# ポイントデータにする
ghpython_script = GhPythonScript(x=sub_list.List)  # -> out, a; inputs x: list
# ---------- ghpython_script: Python ----------
import Rhino.Geometry as rg

try:
    data = [float(v) for v in x]
except Exception as e:
    print("変換エラー: " + str(e))
    a = []
    raise e

if len(data) < 3:
    print("データ不足: " + str(len(data)))
    a = []
else:
    points = []
    for i in range(0, len(data) - 2, 3):
        px = data[i]   * 10
        py = data[i+2] * 10
        pz = -data[i+1] * 10
        points.append(rg.Point3d(px, py, pz))

    print("points: " + str(len(points)))
    a = points
# ---------- end ghpython_script ----------
point = Point(ghpython_script.a)
panel_3 = Panel(point)
# ポイントデータから線データにする
ghpython_script_2 = GhPythonScript(x=point)  # -> out, a; inputs x: list of Point3d
# ---------- ghpython_script_2: Python ----------
import Rhino.Geometry as rg

points = x

if points is None or len(points) < 2:
    print("ポイントデータなし")
    a = []
else:
    connections = [
        (0, 1), (1, 2), (2, 3), (3, 7),
        (0, 4), (4, 5), (5, 6), (6, 8),
        (9, 10),
        (11, 12), (11, 13), (13, 15), (15, 17), (15, 19), (15, 21), (17, 19),
        (12, 14), (14, 16), (16, 18), (16, 20), (16, 22), (18, 20),
        (11, 23), (12, 24), (23, 24),
        (23, 25), (25, 27), (27, 29), (27, 31), (29, 31),
        (24, 26), (26, 28), (28, 30), (28, 32), (30, 32)
    ]

    lines = []
    for i, j in connections:
        if i < len(points) and j < len(points):
            p1 = points[i]
            p2 = points[j]
            line = rg.Line(p1, p2)
            lines.append(line)

    print("lines: " + str(len(lines)))
    a = lines
# ---------- end ghpython_script_2 ----------
line = Line(ghpython_script_2.a)
